# Grasshopper definition latent_space_vis_demo_v3.gh (Grasshopper 1.0.7)
# plug-ins: SonicMat, GH_CPython

number_slider = Slider(3, range=2..3)
encoder = Encoder(
    num_components_input=Slider(3, range=2..3),
    n_dim_input=number_slider,
    perplexity_input=Slider(90, range=0..100),
    learning_rate_input=Slider(100, range=0..100),
    scale_input=Slider(6, range=0..10))  # -> pts_output, dir_output; inputs num_components_input: list, n_dim_input: list, perplexity_input: list, learning_rate_input: list, scale_input: list
#   port pts_output: indicate your output description here. refers to a new line.
# ---------- encoder: Python ----------
# -*- coding: utf-8 -*- 
"""
Python Script for Grasshopper Latent Space Visualisation
Created on Monday October 2024 01:49:03 
@author: willi 
"""

import os
import numpy as np
import cv2 as cv
from skimage import color
from sklearn.decomposition import PCA
from sklearn import manifold
from glob import glob
import time

# Inputs from Grasshopper:
# Ensure these variables match the inputs connected in Grasshopper
# folder_path = folder_path_input  # Input folder path from the Grasshopper panel
folder_path = r'E:\\ucl\\ui\\240\\0 ALL\\'

num_components = num_components_input  # PCA components from number slider
n_dim = n_dim_input                    # t-SNE components (3D visualisation) from slider
perplexity = perplexity_input          # t-SNE perplexity from number slider
learning_rate = learning_rate_input    # t-SNE learning rate from number slider
scale = scale_input                    # Scaling factor for 3D points from slider

# Reading image files
image_files = glob(os.path.join(folder_path, '*.png'))  # Fetch all jpg images
num_imgs = len(image_files)  # Count number of images

# Ensure there are images to process
if num_imgs == 0:
    raise ValueError("No images found in the folder.")

# Process images and prepare the stack for PCA
im_stack = []

for img_path in image_files:
    img = cv.imread(img_path)
    if img is not None:
        # Convert to greyscale
        img_gray = color.rgb2gray(img)
        
        # Resize to 256x256
        new_size = (256, 256)
        img_gray = cv.resize(img_gray, new_size, interpolation=cv.INTER_AREA)
        
        # Flatten the image and append to stack
        im_stack.append(img_gray.flatten())

# Convert the stack to a NumPy array
im_stack = np.array(im_stack)

# Perform PCA for dimensionality reduction
pca = PCA(n_components=num_components)
low_matrix = pca.fit_transform(im_stack)

# t-SNE for further reduction to 3D coordinates
tsne = manifold.TSNE(n_components=n_dim, init='pca', random_state=0, perplexity=perplexity, learning_rate=learning_rate)
X_tsne = tsne.fit_transform(low_matrix)  # Apply t-SNE on PCA-reduced data
X_tsne = X_tsne * scale  # Optionally scale the coordinates

# Output: 3D coordinates for each image (to be visualised in Grasshopper)
output_points = X_tsne.tolist()  # Convert NumPy array to list for GH output

# Pass the 3D coordinates to Grasshopper for visualisation as points
pts_output = output_points

# Optionally, print the result
for i, pt in enumerate(pts_output):
    print("Image {} 3D coordinates: {}".format(i+1, pt))

#-------------------------------

# List out all the contents in the folder (no need to modify)
dir_files = os.listdir(folder_path)

dir_output = []
for file in dir_files:
    dir_output.append(os.path.join(folder_path, file))

print(dir_output)
# ---------- end encoder ----------
panel = Panel(encoder.dir_output)
panel_2 = Panel(encoder.pts_output)
split = TextSplit(Text=panel, Separators="'")  # -> simplify(Result)
panel_3 = Panel(split)
partition = PartitionList(List=panel_2, Size=number_slider)
series = Series(Start="0", Step="1", Count="250")
item = ListItem(List=panel_3, Index="1", Wrap=True)  # -> flatten(Item)
item_2 = ListItem(List=partition, Index=1, Wrap=True)
item_3 = ListItem(List=partition, Index=0, Wrap=True)
item_4 = ListItem(List=partition, Index=2, Wrap=True)
panel_4 = Panel(series)
panel_5 = Panel(item)
pt = ConstructPoint(XCoordinate=item_3, YCoordinate=item_2, ZCoordinate=item_4)
list_item = ListItem(List=flatten(pt), Index=panel_4, Wrap=Toggle(False))
scale = Slider(30, range=0..100)
polyline = PolyLine(Vertices=list_item, Closed=False)
panel_6 = Panel(list_item)
number_slider_2 = Slider(10, range=0..10)
box = CenterBox(Base=pt, X=scale, Y=scale, Z=0)
explode = Explode(Curve=polyline, Recursive=True)  # -> Segments, Vertices
custom_preview = CustomPreview(Geometry=list_item, Material=ColourSwatch(SwatchColor=RGB(204, 47, 47)))
xy_plane = XYPlane(Origin=Point(0, 0, 0))
number_slider_3 = Slider(9, range=0..63)
cylinder = Cylinder(Base=list_item, Radius=Slider(10, range=0..10), Length=Slider(10, range=0..10))
list_item_2 = ListItem(List=explode.Segments, Index=Slider(158, range=0..300), Wrap=True)
rectangle = Rectangle(box)
mat = Material(Surface=flatten(box), String=panel_5, Double=Slider(0, range=0..100))
square = Square(Plane=PlaneXY(0, 0, 0), Size="1", ExtentX="522", ExtentY="522")  # -> Cells, Points
gh_cpython = GH_CPython()  # -> output, a, b; inputs input: list
#   port input: [required] - [type = int] - [default = None] Descripe your input here * bullet point. * bullet point
#   port output: indicate your output description here. refers to a new line.
# ---------- gh_cpython: Python ----------
import Grasshopper
import Grasshopper.Kernel
import System
import System.Drawing as drawing
import os

def get_images_from_folder(folder_path):
   
    images = []
    for filename in os.listdir(folder_path):
        if filename.lower().endswith(('.png', '.jpg', '.jpeg')):
            images.append(os.path.join(folder_path, filename))
    return images

def create_point_cloud_from_images(images):

    points = []
    colors = []
    
    for img_path in images:
        img = drawing.Bitmap(img_path)
        width, height = img.Width, img.Height
        
       
        for x in range(width):
            for y in range(height):
                color = img.GetPixel(x, y)
            
                points.append((x, y, 0))  
                colors.append((color.R, color.G, color.B))
    
    return points, colors


folder_path = "E:\\ucl\\ui\\achi\\"  

images = get_images_from_folder(folder_path)
points, colors = create_point_cloud_from_images(images)


a = points  
b = colors
# ---------- end gh_cpython ----------
custom_preview_2 = CustomPreview(Geometry=list_item_2, Material=ColourSwatch(SwatchColor=RGB(255, 255, 255)))
custom_preview_3 = CustomPreview(Geometry=rectangle, Material=ColourSwatch(SwatchColor=RGB(118, 156, 112)))
shift_list = ShiftList(List=pt, Shift="1", Wrap=Toggle(True))
image_sampler = ImageSampler(square.Points, Filter="Colour", Interpolate=False, Umax=522, Umin=0, Vmax=522, Vmin=0, Wrap=1)
param_viewer = ParamViewer(shift_list)
panel_7 = Panel(shift_list)
split_ahsv = SplitAHSV(Colour=image_sampler)  # -> Alpha, Hue, Saturation, Value
distance = Distance(PointA=flatten(pt), PointB=shift_list)  # -> flatten(Distance)
flatten_tree = FlattenTree(Tree=param_viewer, Path="{0}")
param_viewer_2 = ParamViewer(flatten_tree)
multiplication = Multiplication(A=split_ahsv.Value, B=Slider(49, range=0..100))
line = Line(StartPoint=flatten(shift_list), EndPoint=pt)  # -> flatten(Line)
smaller_than = SmallerThan(FirstNumber=distance, SecondNumber=Slider(0, range=0..1000))  # -> SmallerThan, OrEqualTo
unit_z = UnitZ(Factor=multiplication)
move = Move(Geometry=square.Points, Motion=unit_z)  # -> Geometry, Transform
list_item_3 = ListItem(List=line, Index=Slider(0, range=0..10), Wrap=True)
cull_pattern = CullPattern(List=line, CullPattern=smaller_than.SmallerThan)
number_slider_4 = Slider(1, range=0..1)
end = EndPoints(Curve=list_item_2)  # -> Start, End
custom_preview_4 = CustomPreview(Geometry=list_item_3, Material=ColourSwatch(SwatchColor=RGB(175, 214, 102)))
cloud_display = CloudDisplay(Points=move.Geometry, Colours=image_sampler, Size=Slider(0.7, range=0..1), SpriteType=0)
custom_preview_5 = CustomPreview(Geometry=cull_pattern, Material=ColourSwatch(SwatchColor=RGB(233, 23, 40)))
panel_8 = Panel(list_item_3)
pdecon = Deconstruct(Point=end.Start)  # -> XComponent, YComponent, ZComponent
pdecon_2 = Deconstruct(Point=end.End)  # -> XComponent, YComponent, ZComponent
eval = Evaluate(F="x + (y-x)*z", x=pdecon.XComponent, y=pdecon_2.XComponent, z=number_slider_4)
eval_2 = Evaluate(F="x + (y-x)*z", x=pdecon.YComponent, y=pdecon_2.YComponent, z=number_slider_4)
eval_3 = Evaluate(F="x + (y-x)*z", x=pdecon.ZComponent, y=pdecon_2.ZComponent, z=number_slider_4)
panel_9 = Panel(eval)
panel_10 = Panel(eval_2)
panel_11 = Panel(eval_3)
pt_2 = ConstructPoint(XCoordinate=panel_9, YCoordinate=panel_10, ZCoordinate=panel_11)
