# Grasshopper definition pointcloud.gh (Grasshopper 1.0.7)

xy_plane = XYPlane(Origin=Point(0, 0, 0))
square = Square(Plane=xy_plane, Size="1", ExtentX="522", ExtentY="287")  # -> Cells, Points
image_sampler = ImageSampler(
    square.Points,
    FilePath="C:\Users\ROG\Desktop\建筑\10.png",
    Filter="Colour",
    Interpolate=False,
    Umax=522,
    Umin=0,
    Vmax=522,
    Vmin=0,
    Wrap=1)
split_ahsv = SplitAHSV(Colour=image_sampler)  # -> Alpha, Hue, Saturation, Value
panel = Panel(split_ahsv.Value)
multiplication = Multiplication(A=panel, B=Slider(100, range=0..100))
panel_2 = Panel(multiplication)
unit_z = UnitZ(Factor=panel_2)
move = Move(Geometry=square.Points, Motion=unit_z)  # -> Geometry, Transform
cloud_display = CloudDisplay(Points=move.Geometry, Colours=image_sampler, Size=Slider(0.7, range=0..1), SpriteType=0)
